# Grasshopper definition 4 Point surface with mid-support.gh (Grasshopper 1.0.7)
# plug-ins: GSA

pt = ConstructPoint(XCoordinate=Slider(1, range=0..15), YCoordinate=Slider(5, range=0..15), ZCoordinate=0)
pt_2 = ConstructPoint(XCoordinate=Slider(0, range=0..15), YCoordinate=Slider(0, range=0..15), ZCoordinate=0)
pt_3 = ConstructPoint(XCoordinate=Slider(8, range=0..15), YCoordinate=Slider(0, range=0..15), ZCoordinate=0)
pt_4 = ConstructPoint(XCoordinate=Slider(7, range=0..15), YCoordinate=Slider(8, range=0..15), ZCoordinate=0)
no = Node([pt_2, pt_3, pt_4, pt])
srf4pt = _4PointSurface(CornerA=pt_2, CornerB=pt_3, CornerC=pt_4, CornerD=pt)

# ---- group: 2D Property
material = CreateCustomMaterial(
    ElasticModulus_MPa="30000",
    PoissonsRatio="0.3",
    Density_kg_m³="2500",
    Material_Type="Concrete",
    Stress_Unit="MPa",
    Density_Unit="kg/m³",
    Temperature_Unit="K")
prop2d = Create2DProperty(Thickness_mm=Slider(245, range=0..1000), Material=material, Type="Flat Plate", Unit="mm")

# ----
brep = Brep(srf4pt)

# ---- group: Mid support coordinates
# Genomes
number_slider = Slider(0.597, range=0..1)
number_slider_2 = Slider(0.433, range=0..1)

# ----
pt_5 = ConstructPoint(XCoordinate=number_slider, YCoordinate=number_slider_2, ZCoordinate=0)
evalsrf = EvaluateSurface(Surface=reparameterize(brep), Point=pt_5)  # -> Point, Normal, UDirection, VDirection, Frame
no_2 = Node(no)
mem2d = Create2DMember(
    Brep=srf4pt,
    InclPoints=evalsrf.Point,
    Property2D=prop2d,
    MeshSizeInModelUnits=Slider(0.32, range=0..1),
    InternalOffset=True,
    Preview3dSection=False,
    Mesh_mode="Quad dominant")

# ---- group: Loads
faceload = CreateFaceLoad(
    LoadCase="2",
    ElementList=mem2d,
    Axis=-1,
    Direction="z",
    Projected=False,
    Value_kN_m²=Slider(-3.5, range=-5..0),
    Type="Uniform",
    Unit="kN/m²")
gravityload = CreateGravityLoad(LoadCase="1", GravityFactor=Vector(0, 0, -1))

# ----
support = CreateSupport(Point=[no_2, evalsrf.Point], Plane=PlaneXY(0, 0, 0), x=True, xx=False, y=True, yy=False, z=True, zz=False)

# ---- group: Combinations
createcombination = CreateCombinationCase(ID=0, Name="ULS combination", Description="1.35A1 + 1.5A2")

# ----
analyse = AnalyseModel(
    GSAGeometryIn_m=flatten([support, mem2d]),
    Loads=[gravityload, faceload],
    AnalysisTasksCombinations=createcombination,
    Analyse=True,
    ReMesh=True,
    Tolerance=0.05,
    Geometry_Unit="Meter")  # -> Model, Errors, Warnings, Remarks, Log
selres = SelectResult(GSAModel=analyse.Model, Type="Combination", Case_ID="C1", Permutation="P1")
contournode = NodeContourResults(
    Result=selres,
    Scalar=10,
    Display=3,
    Mode=1,
    envelope="Absolute",
    force="kN",
    legend=False,
    legendScale=1,
    length="mm",
    moment="kN·m",
    noDec=0,
    Result_Type="Reaction",
    Component="Resolved |F|",
    slider=False,
    val=0,
    valMax=1000,
    valMin=0)  # -> P, Colours, Values_kN
disp2d = _2DDisplacements(Result=selres, ElementFilterList="All", Max_Min="All", Unit="Millimeter")  # -> TranslationsX_mm, TranslationsY_mm, TranslationsZ_mm, TranslationsXYZ_mm, RotationsXX_rad, RotationsYY_rad, RotationsZZ_rad, RotationsXYZ_rad
contourelem2d = _2DContourResults(
    Result=selres,
    ElementFilterList="All",
    Display=3,
    Mode=0,
    envelope="Absolute",
    flayer=0,
    force="kN/m",
    legend=True,
    legendScale=1,
    length="mm",
    model="m",
    moment="kN",
    noDec=0,
    Result_Type="Displacement",
    Component="Resolved |U|",
    slider=True,
    stress="MPa",
    val=0,
    valMax=1000,
    valMin=0)  # -> Mesh, Colours, Values_mm
item = ListItem(List=disp2d.TranslationsZ_mm, Index=0, Wrap=True)  # -> flatten(Item)
abs = Absolute(Value=item)
sort = SortList(Keys=abs)  # -> reverse(Keys), ValuesA
item_2 = ListItem(List=sort.Keys, Index=0, Wrap=True)

# ----
# Run Galapagos solver to find the position
# of mid support which gives minimum
# (Uz) displacement
galapagos = Galapagos(fitness=num, gene=[number_slider_2, number_slider])

# ----
# Fitness (minimise)
num = Number(item_2)

panel = Panel(num)
