# Grasshopper definition Gerber Member.gh (Grasshopper 1.0.7)
# plug-ins: GSA

# ----
# Inputs
length_of_the_beam = Slider(30, range=0..100)
support_position_from_ends = Slider(15, range=0..100)

pt = ConstructPoint(XCoordinate=0, YCoordinate=0, ZCoordinate=0)
multiplication = Multiplication(A=support_position_from_ends, B=0.01)
pt_2 = ConstructPoint(XCoordinate=0, YCoordinate=length_of_the_beam, ZCoordinate=0)

profile = CreateProfile(
    Depth_mm="251.4",
    Width_mm="146.1",
    WebThk_mm="6",
    FlangeThk_mm="8.6",
    catalogueIndex=-1,
    inclSS=False,
    lengthUnit="Millimeter",
    mode="Other",
    Profile_type="I Beam Symmetrical",
    Measure="mm",
    typeIndex=-1)
material = CreateCustomMaterial(
    ElasticModulus_MPa="210000",
    PoissonsRatio=".3",
    Density_kg_m³="7850",
    Material_Type="Steel",
    Stress_Unit="MPa",
    Density_Unit="kg/m³",
    Temperature_Unit="K")
section = CreateSection(Profile=profile, Material=material, Basic_Offset="Centroid")

subtraction = Subtraction(A="1", B=multiplication)
ln = Line(StartPoint=pt, EndPoint=pt_2)
eval = EvaluateCurve(Curve=reparameterize(ln), Parameter=[multiplication, subtraction])  # -> Point, Tangent, Angle
end = EndPoints(Curve=ln)  # -> Start, End

# ---- group: Polyline from start, support and end points
merge = Merge(Data1=end.Start, Data2=eval.Point, Data3=end.End)
pline = PolyLine(Vertices=merge, Closed=False)

# ----
σa = CreateAnalysisCase(Name="Analysis case 1", Description="L1")
σt = CreateAnalysisTask(Name="A1", AnalysisCases=σa, casesParamIndex=2, Solver="Static")

beamload = CreateBeamLoad(
    Loadable1DObjects="all",
    Axis=0,
    Direction="z",
    Projected=False,
    Value_kN_m=Slider(-3.5, range=-5..0),
    Type="Uniform",
    Unit="kN/m")

support = CreateSupport(Point=eval.Point, Plane=PlaneXY(0, 0, 0), x=True, xx=True, y=True, yy=True, z=True, zz=True)
mem1d = Create1DMember(
    Curve=pline,
    Property=section,
    Preview3dSection=False,
    x1=False,
    x2=False,
    xx1=False,
    xx2=False,
    y1=False,
    y2=False,
    yy1=False,
    yy2=False,
    z1=False,
    z2=False,
    zz1=False,
    zz2=False)
analyse = AnalyseModel(
    GSAGeometryIn_m=flatten([mem1d, support]),
    Loads=beamload,
    AnalysisTasksCombinations=σt,
    Analyse=True,
    ReMesh=True,
    Tolerance=0.01,
    Geometry_Unit="Meter")  # -> Model, Errors, Warnings, Remarks, Log

save = SaveGSAModel(GSAModel=analyse.Model, Save=True, FileAndPath="c:/Temp/Gerber member.gwb")

preview3d = Preview3DSections(ElementMember1D2D=analyse.Model)  # -> AnalysisLayerMesh, AnalysisLayerOutlines, DesignLayerMesh, DesignLayerOutlines
selres = SelectResult(GSAModel=analyse.Model, Type="AnalysisCase", Case_ID="A1")
contour1d = Contour1DResults(
    Result=selres,
    IntermediatePoints=Slider(100, range=0..100),
    Scale=Slider(33, range=1..100),
    Display=3,
    Mode=0,
    energy="MJ",
    envelope="Absolute",
    force="kN",
    legend=True,
    legendScale=1,
    length="mm",
    moment="kN·m",
    noDec=0,
    Result_Type="Displacement",
    Component="Resolved |U|",
    slider=True,
    stress="MPa",
    val=65,
    valMax=1000,
    valMin=0)  # -> L, Colours, Values_mm
