# Grasshopper definition Truss.gh (Grasshopper 1.0.7)
# plug-ins: GSA

# ---- group: Chord sections
profile = CreateProfile(
    catalogueIndex=3,
    inclSS=False,
    lengthUnit="Millimeter",
    mode="Catalogue",
    Profile_type="Catalogue",
    Catalogue="Europrofile",
    Type="EP HE beams",
    Profile="HE HE450.B",
    typeIndex=27)
material = CreateCustomMaterial(
    ElasticModulus_MPa="210000",
    PoissonsRatio=".3",
    Density_kg_m³="7850",
    Material_Type="Steel",
    Stress_Unit="MPa",
    Density_Unit="kg/m³",
    Temperature_Unit="°C")
section = CreateSection(Profile=profile, Material=material, Basic_Offset="Centroid")

# ----
number_slider = Slider(15, range=0..100)
pt = ConstructPoint(XCoordinate=0, YCoordinate=number_slider, ZCoordinate=0)
pt_2 = ConstructPoint(XCoordinate=0, YCoordinate=0, ZCoordinate=0)
ln = Line(StartPoint=pt_2, EndPoint=pt)
division = Division(A=number_slider, B=Slider(9, range=9..30))
mem1d = Create1DMember(
    Curve=ln,
    Property=section,
    Preview3dSection=False,
    x1=False,
    x2=False,
    xx1=False,
    xx2=False,
    y1=False,
    y2=False,
    yy1=False,
    yy2=False,
    z1=False,
    z2=False,
    zz1=False,
    zz2=False)

# ---- group: Vertical sections
profile_2 = CreateProfile(
    catalogueIndex=3,
    inclSS=False,
    lengthUnit="Millimeter",
    mode="Catalogue",
    Profile_type="Catalogue",
    Catalogue="Europrofile",
    Type="EP HE beams",
    Profile="HE HE100.A",
    typeIndex=27)
material_2 = CreateCustomMaterial(
    ElasticModulus_MPa="210000",
    PoissonsRatio=".3",
    Density_kg_m³="7850",
    Material_Type="Steel",
    Stress_Unit="MPa",
    Density_Unit="kg/m³",
    Temperature_Unit="°C")
section_2 = CreateSection(Profile=profile_2, Material=material_2, Basic_Offset="Centroid")

# ----
Z = UnitZ(Factor=division)
support = CreateSupport(Point=pt_2, Plane=PlaneXY(0, 0, 0), x=True, xx=True, y=True, yy=True, z=True, zz=True)
move = Move(Geometry=mem1d, Motion=Z)  # -> Geometry, Transform
move_2 = Move(Geometry=support, Motion=Z)  # -> Geometry, Transform
rev = Reverse(Vector=Z)
divide = DivideCurve(Curve=move.Geometry, Count=Slider(7, range=5..15), Kinks=False)  # -> Points, Tangents, Parameters
no = Node([move_2.Geometry, support])
line = LineSDL(Start=divide.Points, Direction=rev, Length=rev)
end = EndPoints(Curve=line)  # -> Start, End
shift = ShiftList(List=end.End, Shift=1, Wrap=False)
ln_2 = Line(StartPoint=divide.Points, EndPoint=shift)
mem1d_2 = Create1DMember(
    Curve=[ln_2, line],
    Property=section_2,
    Preview3dSection=False,
    x1=False,
    x2=False,
    xx1=False,
    xx2=False,
    y1=False,
    y2=False,
    yy1=False,
    yy2=False,
    z1=False,
    z2=False,
    zz1=False,
    zz2=False)
X = UnitX(Factor=Slider(3, range=0..10))
no_2 = Node(no)
move_3 = Move(Geometry=no_2, Motion=X)  # -> Geometry, Transform
line_2 = LineSDL(Start=end.Start, Direction=X, Length=X)
m1d = _1DMember([move.Geometry, mem1d, mem1d_2])
no_3 = Node([no_2, move_3.Geometry])
move_4 = Move(Geometry=m1d, Motion=X)  # -> Geometry, Transform
mem1d_3 = Create1DMember(
    Curve=line_2,
    Property=section_2,
    Preview3dSection=False,
    x1=False,
    x2=False,
    xx1=False,
    xx2=False,
    y1=False,
    y2=False,
    yy1=False,
    yy2=False,
    z1=False,
    z2=False,
    zz1=False,
    zz2=False)
gravityload = CreateGravityLoad(LoadCase=null, GravityFactor=Vector(0, 0, -1))
m1d_2 = _1DMember([m1d, move_4.Geometry])
analyse = AnalyseModel(
    GSAGeometryIn_m=flatten([no_3, m1d_2, mem1d_3]),
    Loads=gravityload,
    Analyse=True,
    ReMesh=True,
    Tolerance=0.01,
    Geometry_Unit="Meter")  # -> Model, Errors, Warnings, Remarks, Log
selres = SelectResult(GSAModel=analyse.Model, T="A", Case="1", Type="AnalysisCase", Case_ID="A1")
contour1d = Contour1DResults(
    Result=selres,
    IntermediatePoints=10,
    Scale=10,
    Display=3,
    Mode=0,
    energy="J",
    envelope="Absolute",
    force="N",
    legend=True,
    legendScale=1,
    length="mm",
    moment="N·m",
    noDec=0,
    Result_Type="Displacement",
    Component="Resolved |U|",
    slider=True,
    stress="MPa",
    val=250,
    valMax=1000,
    valMin=0)  # -> L, Colours, Values_mm
res = Result(selres)
beamdisp = BeamDisplacements(Result=res, IntermediatePoints=3, Max_Min="All", Unit="mm")  # -> TranslationsX_mm, TranslationsY_mm, TranslationsZ_mm, TranslationsXYZ_mm, RotationXX_rad, RotationYY_rad, RotationZZ_rad, RotationXYZ_rad
sort = SortList(Keys=flatten(beamdisp.TranslationsXYZ_mm))  # -> Keys, ValuesA
item = ListItem(List=reverse(sort.Keys), Index=0, Wrap=True)

# ---- group: MaxU
num = Number(item)

# ----
maxdeflection = Panel(num)
